vi "QPSK_RX.gvi"   [LabVIEW Communications System Design Software 2.0.1]
panel controls:
  "IQ rate": f64 = 800000
  "carrier frequency": f64 = 915000000
  "gain (dB)": f64
  "active antenna": string = "RX2"
  "Symbol rate (sym/s)": i64 = 200000
  "Equalizer length": i32 = 11
  "Component choice": enum{"I", "Q", "Magnitude", "Phase"} = "I"
  "Device names": string = "NI2900"
  "Graphs": bool
  "Mode": enum{"Compressor", "Denoiser"} = "Compressor"
  "Matched filter": T2 = "Root Raised Cos"
panel indicators:
  "actual IQ rate": f64
  "actual carrier frequency": f64
  "actual gain (dB)": f64
  "error out": error
  "Output bits": i8[]
  "Message length (bits)": i64
  "BER": f64
  "Constellation Graph": T1[]
  "Output length (bits)": i32
  "Equalized Eye Diagram": cluster{"t0": f64, "dt": f64, "Y": f64[]}[]
  "Baseband Output": waveform<f64>
  "Unequalized Eye Diagram": cluster{"t0": f64, "dt": f64, "Y": f64[]}[]
types:
  T1 = cluster{"constellation": f64[], "oversampled data": f64[]}
  T2 = enum{"none", "Raised Cosine", "Root Raised Cos", "Gaussian"}
uses:
  NI::Analysis::Operations::1D Convolution (CDB).gvi
  NI::Analysis::Resampling::Decimate (single shot, CDB).gvi
diagram:
  case ($Mode) {
    frame "Compressor", Default {
      w1 = 1024
    }
    frame "Denoiser" {
      w1 = 80000
    }
  }
  call "niUSRP Open Rx Session.gvi"(niUSRP Device=$"Device names") -> (error out=w2, session handle out=w3)
  call "niUSRP Configure Signal.gvi"(session handle=w3, IQ rate=$"IQ rate", carrier frequency=$"carrier frequency", gain=$"gain (dB)", error in (no error)=w2, active antenna=$"active antenna") -> (session handle out=w4, coerced IQ rate=w5, coerced carrier frequency=w6, coerced gain=w7, Error Out=w8)
  # samples/symbol
  Divide(x=w5, y=$"Symbol rate (sym/s)") -> w9
  call "niUSRP Initiate.gvi"(session handle=w4, error in (no error)=w8) -> (session handle out=w10, Error Out=w11)
  Multiply(w1, w9, 2) -> w12
  call "niUSRP Fetch Rx Data (CDB Cluster).gvi"(session handle=w10, number of samples=w12, error in (no error)=w11) -> (session handle out=w13, data=w14, Error Out=w15)
  Property Node(instance in=w14) -> ("Y"=w16, "dt"=w17)
  # Matched Filter
  call "MT Generate Filter Coefficients.gvi"(pulse shaping filter=$"Matched filter", matched samples per symbol=w9, modulation type="PSK") -> (matched filter coefficients=w18)
  call "1D Convolution (CDB).gvi"(x=w16, y=w18) -> (x * y=w19)
  w20 = cluster{"t0": f64, "dt": f64, "Y": c128[]} {all zero or empty}
  Property Node(instance in=w20, "dt"=w17, "Y"=w19) -> (instance out=w21)
  # Pulse Sync
  call "PulseAlign.gvi"(Input Signal=w21, Receiver Sampling Factor=w9) -> (Output Signal=w22)
  Property Node(instance in=w22) -> ("Y"=w23)
  # Downsample
  call "Decimate (single shot, CDB).gvi"(input array=w23, decimating factor=w9) -> (decimated array=w24)
  # Frame Sync
  call "FrameSync.gvi"(Input Signal=w22, Sampled Input=w24, Receiver Sampling Factor=w9) -> (Output Signal=w25)
  # Equalizer, Detection &
  # Symbol Mapping
  call "QPSK_Equalizer.gvi"(Equalizer Length=$"Equalizer length", Input Complex Waveform=w25, Receiver Sampling Factor=w9) -> (Equalized Complex Waveform=w26, Output Bits=w27)
  Array Subset(array=w27, index0=52, length0=w1) -> w28
  $"Output bits" <- w28
  call "niUSRP Abort.gvi"(Handle in=w13, error in (no error)=w15) -> (Handle out=w29, Error Out=w30)
  call "niUSRP Close Session.gvi"(handle in=w29, error in=w30) -> (error out=w31)
  call "Simple Error Handler.gvi"(error in=w31) -> (error out=w32)
  $"error out" <- w32
  Array Size(array=w28) -> (size(s)=w33)
  $"Output length (bits)" <- w33
  $"actual IQ rate" <- w5
  $"actual carrier frequency" <- w6
  $"actual gain (dB)" <- w7
  Get Component Directory() -> (Path=w34)
  # Open encoded
  File Or Directory Info(path=w34) -> (path out=w35)
  Path To String(path=w35) -> (string=w36)
  Concatenate Strings(w36, "\\app\\data\\encoded.csv") -> w37
  String To Path(string=w37) -> (path=w38)
  call "Read from Spreadsheet File (DBL).gvi"(file path=w38, maximum characters per line=1) -> (all rows=w39)
  Array Index(array=w39) -> (out0[_, 0]=w40)
  Array Size(array=w40) -> (size(s)=w41)
  Subtract(x=w28, y=w40) -> w42
  Absolute Value(x=w42) -> w43
  Add Array Elements(numeric array=w43) -> (sum=w44)
  Divide(x=w44, y=w41) -> w45
  $BER <- w45
  # Create decoded
  Concatenate Strings(w36, "\\app\\data\\demod.csv") -> w46
  String To Path(string=w46) -> (path=w47)
  Array Size(array=w28) -> (size(s)=w48)
  Is Greater(x=w48, y=1) -> w49
  # BER
  case (w49) {
    frame False, Default { }
    frame True {
      Open Or Create Or Replace File(file path (use dialog)=w47, operation (0:open)="create")
      call "Write to Spreadsheet File (DBL).gvi"(file path=w47, 1D data=w28, delimiter=",")
    }
  }
  case ($Graphs) {
    frame False, Default { }
    frame True {
      call "MT Format Eye Diagram (complex).gvi"(waveform=w26, symbol rate=$"Symbol rate (sym/s)", eye length=2) -> (eye diagram=w50)
      $"Equalized Eye Diagram" <- w50
      call "MT Get Complex IQ Component.gvi"(IQ data in=w21, component choice=$"Component choice") -> (CE component=w51)
      $"Baseband Output" <- w51
      call "MT Format Eye Diagram (WDT).gvi"(waveform=w51, symbol rate=$"Symbol rate (sym/s)", eye length=2) -> (eye diagram=w52)
      $"Unequalized Eye Diagram" <- w52
      call "MT Format Constellation.gvi"(waveform=w26, samples per symbol=w9) -> (constellation graph=w53)
      $"Constellation Graph" <- w53
    }
  }
  $"Message length (bits)" <- w1
