vi "QPSK_TX.gvi"   [LabVIEW Communications System Design Software 2.0.1]
panel controls:
  "IQ rate": f64 = 800000
  "carrier frequency": f64 = 915000000
  "gain (dB)": f64
  "active antenna": string = "TX1"
  "Symbol rate (sym/s)": i32 = 200000
  "Device names": string = "NI2900"
  "Reset": bool
  "Stop": bool
  "Mode": enum{"Compressor", "Denoiser"} = "Compressor"
  "Pulse shaping filter": T2 = "Root Raised Cos"
panel indicators:
  "actual IQ rate": f64
  "actual carrier frequency": f64
  "actual gain (dB)": f64
  "error out": error
  "source bit stream": i8[]
  "Baseband Signal": cluster{"t0": f64, "dt": f64, "Y": c128[]}
  "Power Spectrum": T1
types:
  T1 = cluster{"f0": f64, "df": f64, "magnitude": f64[]}
  T2 = enum{"none", "Raised Cosine", "Root Raised Cos", "Gaussian"}
uses:
  NI::Analysis::Resampling::Upsample (CDB).gvi
  NI::Analysis::Operations::1D Convolution (CDB).gvi
diagram:
  Get Component Directory() -> (Path=w1)
  File Or Directory Info(path=w1) -> (path out=w2)
  Path To String(path=w2) -> (string=w3)
  # Run the Python app
  Concatenate Strings(w3, "\\app\\data\\encoded.csv") -> w4
  # Delete encoded file
  String To Path(string=w4) -> (path=w5)
  Delete File Or Folder(path (use dialog)=w5)
  # DSP mode selection
  case ($Mode) {
    frame "Compressor", Default {
      w6 = "\\app && python compressor.py"
    }
    frame "Denoiser" {
      w6 = "\\app && python denoiser.py"
    }
  }
  Concatenate Strings("cmd /c cd ", w3) -> w7
  Concatenate Strings(w7, w6) -> w8
  call "System Exec.gvi"(command line=w8, run minimized?=TRUE)
  while {
    # Wait until encoded file is created
    while {
      Open Or Create Or Replace File(file path (use dialog)=w5) -> (error out=w9)
      call "Is Error.gvi"(error in=w9) -> (is error?=w10)
      Not(x=w10) -> w11
      Wait(time to wait=1000)
      stop if w11
    }
    call "Read from Spreadsheet File (DBL).gvi"(file path=w5, maximum characters per line=1) -> (all rows=w12)
    Array Index(array=w12) -> (out0[_, 0]=w13)
    $"source bit stream" <- w13
    call "niUSRP Open Tx Session.gvi"(Device names=$"Device names") -> (session handle out=w14, Error Out=w15)
    call "niUSRP Configure Signal.gvi"(session handle=w14, IQ rate=$"IQ rate", carrier frequency=$"carrier frequency", gain=$"gain (dB)", error in (no error)=w15, active antenna=$"active antenna") -> (session handle out=w16, coerced IQ rate=w17, coerced carrier frequency=w18, coerced gain=w19)
    Divide(x=w17, y=$"Symbol rate (sym/s)") -> w20
    w21 = [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]  # Symbol Map
    # Symbol Map
    call "MT Map Bits to PSK Symbols.gvi"(input bit stream=w13, symbol map=w21) -> (symbols=w22)
    # Framing
    call "FrameHeader.gvi"(Array in=w22) -> (Array out=w23)
    # Upsampling
    call "Upsample (CDB).gvi"(input array=w23, upsampling factor=w20) -> (upsampled array=w24)
    call "MT Generate Filter Coefficients.gvi"(pulse shaping filter=$"Pulse shaping filter", pulse shaping samples per symbol=w20, modulation type="PSK") -> (pulse shaping filter coefficients=w25)
    # Pulse Shaping
    call "1D Convolution (CDB).gvi"(x=w24, y=w25) -> (x * y=w26)
    Absolute Value(x=w26) -> w27
    call "Quick Scale 1D.gvi"(X=w27) -> (max|X|=w28)
    # Scaling
    Divide(x=w26, y=w28) -> w29
    Reciprocal(x=w17) -> w30
    w31 = cluster{"t0": timestamp, "dt": f64, "Y": c128[]} {all zero or empty}
    Property Node(instance in=w31, "Y"=w29, "dt"=w30) -> (instance out=w32)
    w33 = TRUE  # dB on
    call "FFT Power Spectrum for 1 Ch.gvi"(time signal=w32, dB On (F)=w33) -> (power spectrum=w34, Error Out=w35)
    while {
      call "niUSRP Write Tx Data (CDB).gvi"(session handle=w16, data=w29, end of data?=$Reset, error in (no error)=w35) -> (session handle out=w36, Error Out=w37)
      Logical Or(w37, $Reset) -> w38
      stop if w38
    }
    call "niUSRP Close Session.gvi"(handle in=w36, error in=w37) -> (error out=w39)
    call "Simple Error Handler.gvi"(error in=w39) -> (error out=w40)
    $"error out" <- w40
    w41 = cluster{"t0": f64, "dt": f64, "Y": c128[]} {all zero or empty}
    Property Node(instance in=w41, "dt"=w30, "Y"=w29) -> (instance out=w42)
    $"Baseband Signal" <- w42
    $"actual IQ rate" <- w17
    $"actual carrier frequency" <- w18
    $"actual gain (dB)" <- w19
    $"Power Spectrum" <- w34
    stop if $Stop
  }
