vi "PulseAlign.gvi"   [LabVIEW Communications System Design Suite 2.0.1]
inputs:
  "Input Signal": cluster{"t0": f64, "dt": f64, "Y": c128[]}
  "Receiver Sampling Factor": i32 = 100
  "error in (no error)": error
outputs:
  "Output Signal": cluster{"t0": f64, "dt": f64, "Y": c128[]}
  "alignment offset (samples)": i32
  "error out": error
panel indicators:
  "Objective Function": f64[]
uses:
  NI::Analysis::Resampling::Decimate (single shot, CDB).gvi
diagram:
  Property Node(instance in=$"Input Signal") -> ("Y"=w1)
  for (N = $"Receiver Sampling Factor") (iteration -> i1) {
    Array Subset(array=w1, index0=i1) -> w3
    call "Decimate (single shot, CDB).gvi"(input array=w3, decimating factor=$"Receiver Sampling Factor") -> (decimated array=w4, error out=w5)
    Complex To Polar(r * e^(i*theta)=w4) -> (r=w6)
    Square(x=w6) -> w7
    Add Array Elements(numeric array=w7) -> (sum=w8)
    Property Node(instance in=w5)
    append w8 to w2
  }
  Array Max And Min(array=w2) -> (max index(es)=w9)
  Array Subset(array=w1, index0=w9) -> w10
  Property Node(instance in=$"Input Signal", "Y"=w10) -> (instance out=w11)
  $"Output Signal" <- w11
  $"Objective Function" <- w2
  $"alignment offset (samples)" <- w9
  $"error out" <- $"error in (no error)"
