vi "QPSK_Equalizer.gvi"   [LabVIEW Communications System Design Suite 2.0.1]
inputs:
  "Equalizer Length": i32 = 11
  "Input Complex Waveform": cluster{"t0": f64, "dt": f64, "Y": c128[]} = {"t0"=0, "dt"=1, "Y"=[]}
  "Receiver Sampling Factor": f64
  "error in": error
outputs:
  "Equalized Complex Waveform": cluster{"t0": f64, "dt": f64, "Y": c128[]}
  "Output Bits": i8[]
  "Squared Error": f64[]
  "error out": error
  "Equalizer Coefficients Out": c128[]
types:
  T1 = cluster{"taps per symbol": i32, "delta (training)": f64, "delta (steady state)": f64}
diagram:
  case ($"error in") {
    frame No Error {
      call "MT Generate PSK System Parameters(M).gvi"(samples per symbol=$"Receiver Sampling Factor", M-PSK=4, error in=$"error in") -> (PSK system parameters=w4, error out=w5)
      w6 = [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]  # Symbol Map
      Property Node(instance in=w4, "symbol map"=w6) -> (instance out=w7)  # Cluster Properties
      w8 = T1 {"taps per symbol"=1, "delta (training)"=0.05, "delta (steady state)"=0.001}  # Feedforward Equalizer Params
      w9 = [1, 1, 1, 1, 1, 0, 0, 1, 1, 0, 1, 0, 1]  # Training Bits
      Interleave Array(w9, w9) -> w10
      Build Array[ConcatenateInputs=True](w10, w10) -> w11
      call "MT PSK Feedforward Equalizer (LMS) (Specify length).gvi"(input complex waveform=$"Input Complex Waveform", PSK system parameters=w7, equalizer length=$"Equalizer Length", training bits=w11, error in=w5, feedforward equalizer (lms) parameters=w8) -> (output complex waveform=w2, error=w12, equalizer coefficients out=w13, output bit stream=w3, error out=w1)
      $"Squared Error" <- w12
      $"Equalizer Coefficients Out" <- w13
    }
    frame Error {
      w14 = cluster{"t0": f64, "dt": f64, "Y": c128[]} {"t0"=0, "dt"=1, "Y"=[]}
      w1 = $"error in"
      w2 = w14
      w3 = i8[] []
    }
  }
  $"Equalized Complex Waveform" <- w2
  $"Output Bits" <- w3
  $"error out" <- w1
